# Grasshopper definition disco.gh (Grasshopper 1.0.7)

radius = GetInteger(Slider(53, range=0..100), AtLeast=1, AtMost=1, Maximum=2147483647, Minimum=-2147483648, TreeAccess=False)
divisionsvert = GetInteger(Slider(25, range=0..100), AtLeast=1, AtMost=1, Maximum=2147483647, Minimum=-2147483648, TreeAccess=False)
horzdivisionwidth = GetInteger(Slider(8, range=0..10), AtLeast=1, AtMost=1, Maximum=2147483647, Minimum=-2147483648, TreeAccess=False)
makespikey = GetBoolean(Toggle(False), AtLeast=1, AtMost=1, FalseValue="False", TreeAccess=False, TrueValue="True")
subtraction = Subtraction(A=radius, B=Slider(1, range=0..1))
sph = Sphere(Base=PlaneXY(0, 0, 0), Radius=radius)
sdivide = DivideSurface(Surface=sph, UCount=divisionsvert, VCount=divisionsvert)  # -> Points, Normals, Parameters
flip = FlipMatrix(Data=sdivide.Points)
intcrv = Interpolate(Vertices=flip, Degree=3, Periodic=False, KnotStyle=1)  # -> flatten(Curve), Length, Domain
shift = ShiftList(List=intcrv.Curve, Shift=1, Wrap=False)
shift_2 = ShiftList(List=intcrv.Curve, Shift=-1, Wrap=False)
rulesrf = RuledSurface(CurveA=shift, CurveB=shift_2)
len = Length(Curve=intcrv.Curve)
division = Division(A=len, B=horzdivisionwidth)
divide = DivideDomain²(Domain=rulesrf, UCount=division, VCount=Slider(1, range=0..1))
subsrf = Isotrim(Surface=graft(rulesrf), Domain=divide)
debrep = DeconstructBrep(Brep=subsrf)  # -> Faces, Edges, Vertices
item = ListItem(List=debrep.Vertices, Index=0, Wrap=True)  # -> Item, Item1, Item2, Item3
srf4pt = _4PointSurface(CornerA=item.Item, CornerB=item.Item1, CornerC=item.Item2, CornerD=item.Item3)
neg = Negative(Value=Slider(0.1, range=0..0.1))
offset = OffsetCurve(Curve=srf4pt, Distance=neg, Corners=1)
clean = CleanTree(RemoveNulls=True, RemoveInvalid=True, RemoveEmpty=invert(False), Tree=offset)
area = Area(Geometry=clean)  # -> Area, Centroid
flip_2 = Flip(Surface=clean)  # -> Surface, Result
smesh = SimpleMesh(Brep=flip_2.Surface)
sph_2 = Sphere(Base=PlaneXY(0, 0, 0), Radius=subtraction)
jagged = SettingsSpeed()
facen = FaceNormals(Mesh=smesh)  # -> Centers, Normals
mesh = MeshBrep(Brep=sph_2, Settings=jagged)
multiplication = Multiplication(A=facen.Normals, B=Slider(2, range=0..10))
move = Move(Geometry=area.Centroid, Motion=multiplication)  # -> Geometry, Transform
extr = ExtrudePoint(Base=clean, Point=move.Geometry)
filter = StreamFilter(Gate=makespikey, Stream0=flip_2.Surface, Stream1=extr)
uservalue = Text("sphere")
userkey = Text("name")
smesh_2 = SimpleMesh(Brep=filter)
# Add User Data
c_script = CSharpScript(geometry=mesh, userKey=userkey, userValue=uservalue)  # -> out, geoWithUserString; inputs geometry: GeometryBase, userKey: String, userValue: String
# ---------- c_script: C# ----------
    geometry.SetUserString(userKey, userValue);
   geoWithUserString = geometry;
# ---------- end c_script ----------
yz = YZPlane(Origin=Point(0, 0, 0))
rotate = Rotate(Geometry=smesh_2, Angle="-0.5*pi", Plane=yz)  # -> Geometry, Transform
context_bake = ContextBake(Geometry=c_script.geoWithUserString)
context_bake_2 = ContextBake(Geometry=rotate.Geometry)
