# Grasshopper definition rhino_input.gh (Grasshopper 1.0.7)

number_slider = Slider(1, range=0..10)
encodedfile = GetString(AtLeast=1, AtMost=1, TreeAccess=False)

# ---- group: just to test
path = FilePath("C:\Users\david\IAAC\MaCAD\datamgmt\repos\bimsc24-datamgmt-session06\src\assets\rhino_input.3dm")

# ----
Y = GetNumber(number_slider, AtLeast=1, AtMost=1, Maximum=1.797693135e+308, Minimum=-1.797693135e+308, TreeAccess=False)
Z = GetNumber(number_slider, AtLeast=1, AtMost=1, Maximum=1.797693135e+308, Minimum=-1.797693135e+308, TreeAccess=False)
X = GetNumber(number_slider, AtLeast=1, AtMost=1, Maximum=1.797693135e+308, Minimum=-1.797693135e+308, TreeAccess=False)
# no points allowed in 3dm!
python = GhPythonScript(data=encodedfile, FP=path)  # -> out, geom, layerIndex, layers, instances, instLayInd
# ---------- python: Python ----------
import System
import Rhino

try:
    b64 = System.Convert.FromBase64String(data)
    _dmfile = Rhino.FileIO.File3dm.FromByteArray(b64)
except:
    _dmfile = Rhino.FileIO.File3dm.Read(FP)
    print _dmfile

objtable = _dmfile.Objects

geom = []
geomLayerIndexList = []
for obj in objtable:
    
    if not isinstance(obj.Geometry,Rhino.Geometry.InstanceReferenceGeometry):

        geom.append(obj.Geometry)
        geomLayerIndexList.append(obj.Attributes.LayerIndex)
        

geom_= geom
layerIndex_ = geomLayerIndexList

layers = []
for l in _dmfile.Layers:
    layers.append(l)
    
    




layers_ = layers



instances = []
instancesLayerIndexes = []

# 
for obj in objtable:
    
    if isinstance(obj.Geometry,Rhino.Geometry.InstanceReferenceGeometry):
        geom = obj.Geometry
        parentId = geom.ParentIdefId
        instanceDef = _dmfile.InstanceDefinitions.FindId(parentId)
        instanceDefIds = instanceDef.GetObjectIds()
        
        xf =  geom.Xform
        instancesLayerIndexes.append(obj.Attributes.LayerIndex)
        
        for idefId in instanceDefIds:
            instanceObj= _dmfile.Objects.FindId(idefId)
            newObjGeom = instanceObj.Geometry.Duplicate()
            newObjGeom.Transform(xf)
            instances.append(newObjGeom)
            
            
instances_ = instances
instLayInd_ = instancesLayerIndexes
# ---------- end python ----------
bbox = BoundingBox(Content=python.geom, Plane=PlaneXY(0, 0, 0), UnionBox=True)  # -> Box, Box_2
volume = Volume(Geometry=bbox.Box)  # -> Volume, Centroid
scale_nu = ScaleNU(Geometry=python.geom, Plane=volume.Centroid, ScaleX=X, ScaleY=Y, ScaleZ=Z)  # -> Geometry, Transform
context_bake = ContextBake(ScaledGeo=scale_nu.Geometry)
