# Grasshopper definition wall.gh (Grasshopper 1.0.7)
# plug-ins: ShapeDiverForGrasshopper

sddp = ShapeDiverDocumentPayload({AbsoluteTolerance=0, AngleTolerance=0, DistanceDisplayPrecision=0, GltfVersion="Gltf2", GrasshopperVersion="1.0.0007", InputGroups="{}", OutputGroups="{}", RelativeTolerance=0, RhinoVersion="7.30.23163.13001", UnitSystem=0, VersionCreated="1.16.0.0", VersionSaved="1.16.0.0"})

width = Slider(16, range=0..40)
height = Slider(13, range=1..20)
height_2 = GetInteger(height, AtLeast=1, AtMost=1, Maximum=2147483647, Minimum=-2147483648, TreeAccess=False)
width_2 = GetInteger(width, AtLeast=1, AtMost=1, Maximum=2147483647, Minimum=-2147483648, TreeAccess=False)
verticalrotation = GetInteger(Slider(0, range=0..30), AtLeast=1, AtMost=1, Maximum=2147483647, Minimum=-2147483648, TreeAccess=False)
horizontalrotation = GetInteger(Slider(0, range=0..15), AtLeast=1, AtMost=1, Maximum=2147483647, Minimum=-2147483648, TreeAccess=False)

division = Division(A=width_2, B="2")
negative = Negative(Value=division)
construct_point = ConstructPoint(XCoordinate=negative, YCoordinate=0, ZCoordinate=0)
unit_z = UnitZ(Factor=height_2)
move = Move(Geometry=construct_point, Motion=unit_z)  # -> Geometry, Transform
line = Line(StartPoint=construct_point, EndPoint=move.Geometry)
unit_x = UnitX(Factor=Slider(1, range=0..2))
multiplication = Multiplication(A=height_2, B="2")
panel = Panel("2")
subtraction = Subtraction(A=multiplication, B=Slider(7, range=0..10))
linear_array = LinearArray(Geometry=line, Direction=unit_x, Count=width_2)  # -> Geometry, Transform
dispatch = Dispatch(List=linear_array.Geometry, DispatchPattern=[True, False])  # -> ListA, ListB

number_slider = Slider(0.5, range=0..1)
number_slider_2 = Slider(0.97, range=0..1)
construct_domain = ConstructDomain(DomainStart=number_slider_2, DomainEnd=expr("-x", number_slider_2))
construct_domain_2 = ConstructDomain(DomainStart=number_slider, DomainEnd=expr("-x", number_slider))
unit_z_2 = UnitZ(Factor=Slider(0.63, range=0..1))

divide_curve = DivideCurve(Curve=dispatch.ListB, Count=subtraction, Kinks=False)  # -> Points, Tangents, Parameters
dispatch_2 = Dispatch(List=divide_curve.Points, DispatchPattern=[True, False])  # -> ListA, ListB
point = Point(dispatch_2.ListB)
xy_plane = XYPlane(Origin=point)
rectangle = Rectangle(Plane=xy_plane, XSize=construct_domain, YSize=construct_domain_2, Radius=0)  # -> Rectangle, Length
surface = Surface(rectangle.Rectangle)
extrude = Extrude(Base=surface, Direction=unit_z_2)
volume = Volume(Geometry=extrude)  # -> Volume, Centroid
explode_tree = ExplodeTree(Data=extrude)  # -> Branch0, Branch1
list_length = ListLength(List=dispatch.ListB)
list_length_2 = ListLength(List=explode_tree.Branch0)
series = Series(Start=0, Step=verticalrotation, Count=list_length)
xy_plane_2 = XYPlane(Origin=volume.Centroid)
series_2 = Series(Start=series, Step=horizontalrotation, Count=list_length_2)
rotate = Rotate(Geometry=extrude, Angle=degrees(series_2), Plane=xy_plane_2)  # -> Geometry, Transform

divide_curve_2 = DivideCurve(Curve=dispatch.ListA, Count=subtraction, Kinks=False)  # -> Points, Tangents, Parameters
dispatch_3 = Dispatch(List=divide_curve_2.Points, DispatchPattern=[True, False])  # -> ListA, ListB
point_2 = Point(dispatch_3.ListA)
xy_plane_3 = XYPlane(Origin=point_2)
rectangle_2 = Rectangle(Plane=xy_plane_3, XSize=construct_domain, YSize=construct_domain_2, Radius=0)  # -> Rectangle, Length
surface_2 = Surface(rectangle_2.Rectangle)
extrude_2 = Extrude(Base=surface_2, Direction=unit_z_2)
list_length_3 = ListLength(List=dispatch.ListA)
volume_2 = Volume(Geometry=extrude_2)  # -> Volume, Centroid
explode_tree_2 = ExplodeTree(Data=extrude_2)  # -> Branch0, Branch1
series_3 = Series(Start=0, Step=verticalrotation, Count=list_length_3)
list_length_4 = ListLength(List=explode_tree_2.Branch0)
xy_plane_4 = XYPlane(Origin=volume_2.Centroid)
series_4 = Series(Start=series_3, Step=horizontalrotation, Count=list_length_4)
rotate_2 = Rotate(Geometry=extrude_2, Angle=degrees(series_4), Plane=xy_plane_4)  # -> Geometry, Transform

merge = Merge(Data1=rotate_2.Geometry, Data2=rotate.Geometry)  # -> flatten(Result)

mesh = Mesh(merge)
context_bake = ContextBake(Geometry=mesh)
